vi "Keynote Dashboard.gvi"   [Next Generation LabVIEW Features 0.1.0]
panel controls:
  "stop": bool
  "Shift Tone": bool
  "Slider": f64 = 1
  "Shift Tone_2": bool
panel indicators:
  "Graph": waveform<f64>
  "Responses": i32
  "Intensity Graph": f64[][]
  "error out": error
  "number pending remove": i32
types:
  "Sound Data Format.gtype" = cluster{"sample rate (S/s)": f64, "number of channels": i32, "bits per sample": i32}
uses:
  NI::Analysis::Measurement::STFT Spectrogram.gvi
diagram:
  Obtain Queue(element data type=waveform<f64> {dt=1, Y=[]}) -> (queue out=w1)
  while {
    call "Read Audio Port.gvi"(Number of Samples=1024) -> (data=w2)
    Enqueue Element(element=w2, queue=w1)
    Reciprocal(x=44100)
    stop if $stop
  }
  w3 = "Sound Data Format.gtype" {"sample rate (S/s)"=25600, "number of channels"=1, "bits per sample"=16}
  call "Sound Output Configure.gvi"(sound format=w3, number of samples/ch=1024) -> (task ID=w4)
  call "Sound Output Start.gvi"(task ID in=w4) -> (task ID out=w5)
  s1 = w5  # shift register
  while {
    Dequeue Element(queue=w1) -> (element=w6, queue out=w7)
    case ($"Shift Tone") {
      frame False, Default {
        Build Array(w6) -> w9
        w8 = w6
      }
      frame True {
        call "Modulate Audio.gvi"(set pitch=$Slider, Audio Sample=w6, Slice Set=1024) -> (Waveform=w8, data=w9)
      }
    }
    $Graph <- w8
    call "STFT Spectrogram.gvi"(x=w8) -> (STFT spectrogram=w10)
    $"Intensity Graph" <- w10
    call "Sound Output Write.gvi"(task ID in=s1, data=w9) -> (task ID out=w11)
    next s1 = w11
    stop if $stop
  }
  Release Queue(queue=w7)
  while {
    Get Queue Status(queue=w1) -> (# pending remove=w12, error out=w13)
    $"number pending remove" <- w12
    Wait(time to wait=1000)
    stop if w13
  }
  disable {
    frame Enabled { }
    frame Disabled {
      call "init Tag Read.gvi"() -> (niTag.niTag=w14)
      call "Init tag write.gvi"() -> (niTag.niTag=w15)
      while {
        case ($"Shift Tone_2") {
          frame False, Default { }
          frame True {
            case ($"Shift Tone") {
              frame False, Default { }
              frame True {
                call "Read Tags.gvi"(tag reference in=w14) -> (Responses=w16)
                $Responses <- w16
              }
            }
            call "Write Waveform Tag.gvi"(Waveform=$Graph, Write Task=w15)
          }
        }
        stop if $stop
      }
    }
  }
