vi "Read Tags.gvi"   [Next Generation LabVIEW Features 0.1.0]
inputs:
  "tag reference in": "niTag"
outputs:
  "High": f64
  "Low": f64
  "Pitch Ratio": f64
  "Responses": i32
diagram:
  call "Read Double Values.gvi"(tag reference in=$"tag reference in") -> (aggregate values=w1)
  Property Node(instance in=w1) -> ("mean"=w2, "count"=w3, "max"=w4, "min"=w5)
  $High <- w4
  $Low <- w5
  Multiply(w2, 5) -> w6
  $"Pitch Ratio" <- w6
  $Responses <- w3
