vi "Write Waveform Tag.gvi"   [Next Generation LabVIEW Features 0.1.0]
inputs:
  "Waveform": waveform<f64> = {dt=0.1, Y=[]}
  "Write Task": "niTag"
panel indicators:
  "Weaveform": f64[]  # Returns the output signal formatted as dynamic data.
uses:
  NI::Analysis::Resampling::Decimate (single shot, DBL).gvi
diagram:
  Property Node(instance in=$Waveform) -> ("Y"=w1)
  call "Decimate (single shot, DBL).gvi"(input array=w1, decimating factor=10) -> (decimated array=w2)
  $Weaveform <- w2
  Flatten To JSON(anything=w2) -> (JSON string=w3, error out=w4)
  call "Write (String).gvi"(tag reference in=$"Write Task", error in=w4, string=w3)
