vi "Keynote Dashboard.gvi"   [Next Generation LabVIEW Features 0.1.0]
panel controls:
  "stop": bool
  "Power Button": bool
  "Slider": f64
panel indicators:
  "Low": f64
  "High": f64
  "Graph": waveform<f64>
  "Responses": f64
  "Intensity Graph": f64[][]
  "Error": error
types:
  "Sound Data Format.gtype" = cluster{"sample rate (S/s)": f64, "number of channels": i32, "bits per sample": i32}
uses:
  NI::Analysis::Measurement::STFT Spectrogram.gvi
diagram:
  w1 = "Sound Data Format.gtype" {"sample rate (S/s)"=22000, "number of channels"=2, "bits per sample"=16}
  call "Sound Input Configure.gvi"(sound format=w1, sample mode="Continuous Samples"(1), number of samples/ch=2048) -> (task ID=w2)
  w3 = "Sound Data Format.gtype" {"sample rate (S/s)"=22000, "number of channels"=2, "bits per sample"=16}
  call "Sound Output Configure.gvi"(sound format=w3, number of samples/ch=2048) -> (task ID=w4, error out=w5)
  s1 = w5  # shift register
  s2 = w4  # shift register
  while {
    call "Sound Input Read.gvi"(task ID in=w2, number of samples/ch=2048) -> (data=w6)
    Array Index(array=w6) -> (out0[_]=w7)
    case ($"Power Button") {
      frame False, Default {
        Build Array(w7) -> w9
        w8 = w7
      }
      frame True {
        call "Update Tags.gvi"() -> (High=w10, Low=w11, Responses=w12)
        $Responses <- w12
        $High <- w10
        $Low <- w11
        call "Function_2.gvi"(output waveform=w7, Pitch Ratio=$Slider, Frame Size=2048) -> (Waveform_3=w8, Array=w9)
      }
    }
    call "STFT Spectrogram.gvi"(x=w8) -> (STFT spectrogram=w13)
    $"Intensity Graph" <- w13
    $Graph <- w8
    call "Sound Output Write.gvi"(task ID in=s2, data=w9, error in=s1) -> (task ID out=w14, error out=w15)
    Logical Or(w15, $stop) -> w16
    next s1 = w15
    next s2 = w14
    stop if w16
  }
  $Error <- s1
