vi "Modulate Audio.gvi"   [Next Generation LabVIEW Features 0.1.0]
inputs:
  "set pitch": f64
  "Modulation Scheme": bool
  "Audio Sample": waveform<f64> = {dt=0.1, Y=[]}, required
  "Error": error
  "Slice Set": i32 = 2048
outputs:
  "x": f64[]
  "data": waveform<f64>[]
  "error in": error
  "Last Sample?": bool
diagram:
  call "Slice waveform.gvi"(Waveform=$"Audio Sample", Slice Set=$"Slice Set", Error=$Error) -> (Waveform_2=w1, Error_2=w2, Last Sample=w3)
  call "Vocoder OLD.gvi"(set pitch=$"set pitch", Waveform_2=w1, Error=w2, Window=$"Slice Set") -> (x=w4, data=w5, error in=w6)
  $x <- w4
  $data <- w5
  $"Last Sample?" <- w3
  $"error in" <- w6
