vi "Sound output.gvi"   [Next Generation LabVIEW Features 0.1.0]
inputs:
  "Waveform Constant": waveform<f64> = {dt=0.1, Y=[]}
outputs:
  "data_2": waveform<f64>
types:
  "Sound Data Format.gtype" = cluster{"sample rate (S/s)": f64, "number of channels": i32, "bits per sample": i32}
diagram:
  $data_2 <- $"Waveform Constant"
  Build Array($"Waveform Constant") -> w1
  s1 = uninitialised  # shift register
  while {
    Is First Call() -> w2
    case (w2) {
      frame False, Default {
        w3 = s1
      }
      frame True {
        w4 = "Sound Data Format.gtype" {"sample rate (S/s)"=25600, "number of channels"=1, "bits per sample"=16}
        call "Sound Output Configure.gvi"(sound format=w4, sample mode="Continuous Samples"(1), number of samples/ch=2048) -> (task ID=w5)
        call "Sound Output Start.gvi"(task ID in=w5) -> (task ID out=w3)
      }
    }
    call "Sound Output Write.gvi"(task ID in=w3, data=w1) -> (task ID out=w6)
    next s1 = w6
    stop if TRUE
  }
