vi "Function.gvi"   [LabVIEW Platform Developer Preview 0.1.0]
panel controls:
  "Low": bool
  "High": bool
panel indicators:
  "Graph": f64[]
  "Low Hit": bool
  "High Hit": bool
uses:
  Component::Read Tag Waveform.gvi
  Component::Update Tag.gvi
diagram:
  while (after "modulation") {
    Wait(time to wait=1000)
    call "Read Tag Waveform.gvi"(Server="skyline.southcentralus.cloudapp.azure.com", Tag="waveform") -> (values=w1)
    $Graph <- w1
    stop if FALSE
  }
  while {
    Wait(time to wait=50)
    case ($Low) {
      frame False, Default {
        $"Low Hit" <- FALSE
      }
      frame True {
        Wait(time to wait=500)
        $"Low Hit" <- TRUE
        call "Update Tag.gvi"(Server="skyline.southcentralus.cloudapp.azure.com", Tag="modulation", Tag Value=0)
      }
    }
    case ($High) {
      frame False, Default {
        $"High Hit" <- FALSE
      }
      frame True {
        Wait(time to wait=500)
        $"High Hit" <- TRUE
        call "Update Tag.gvi"(Server="skyline.southcentralus.cloudapp.azure.com", Tag="modulation", Tag Value=2)
      }
    }
    stop if FALSE
  }
